# Dynamo graph ROOMS TO FLOORS.dyn (Dynamo 3.2.1.5366)
# packages: Rhythm 2023.5.5

vyber_místnosti = DSModelElementsByCategorySelection("OST_Rooms")  # 1 picked in the model; graph input
finishBoundary = Room.FinishBoundary(room=vyber_místnosti)
typ_podlahy = FloorTypes()  # nothing selected; graph input
ʳʰʸᵗʰᵐ_rooms_level = Rhythm.Revit.Elements.Rooms.Level(room=vyber_místnosti)
byOutlineTypeAndLevel = Floor.ByOutlineTypeAndLevel(outlineCurves=finishBoundary, floorType=typ_podlahy, level=ʳʰʸᵗʰᵐ_rooms_level)  # graph output
